# Grasshopper definition LasercutProcess_DiniSurface.gh (Grasshopper 1.0.7)

number_slider = Slider(30, range=0..1000)
# CUT SECTIONS RADIALLY ABOUT ORIGIN
default_value_b_0_2 = Panel(Slider(0.2, range=0..4.1))
# 3D PLOT FUNCTION
default_value_a_1 = Panel(Slider(1, range=1..4))
pi = Pi(Factor=1)
multiplication = Multiplication(A=pi, B=4)
dom = ConstructDomain(DomainStart=0, DomainEnd=multiplication)
range = Range(Domain=dom, Steps=Slider(217, range=0..1000))
range_2 = Range(Domain=Domain(0.1, 2), Steps=number_slider)
crossref = CrossReference(ListA=range, ListB=range_2, CrossMode=1)  # -> ListA, ListB
eval = Evaluate(F="a*sin(u)*sin(v)", a=default_value_a_1, u=crossref.ListA, v=crossref.ListB)
eval_2 = Evaluate(F="a*((cos(v))+ln(tan(v/2)))+b*u", a=default_value_a_1, u=crossref.ListA, v=crossref.ListB, b=default_value_b_0_2)
eval_3 = Evaluate(F="a*(cos(u))*(sin(v))", a=default_value_a_1, u=crossref.ListA, v=crossref.ListB)
pt = ConstructPoint(XCoordinate=eval_3, YCoordinate=eval, ZCoordinate=eval_2)
srfgrid = SurfaceFromPoints(Points=pt, UCount=expr("x+1", number_slider), Interpolate=True)
preview = CustomPreview(Geometry=srfgrid, Material=ColourSwatch(SwatchColor=RGB(199, 167, 255)))  # disabled

X = UnitX(Factor=1)
pt_2 = Point(<point referenced from the Rhino model>)
neg = Negative(Value=X)
line = LineSDL(Start=pt_2, Direction=neg, Length=default_value_a_1)
Z = UnitZ(Factor=Slider(-50, range=-50..0))
dom_2 = ConstructDomain(DomainStart=-3.141592654, DomainEnd=0)
extr = Extrude(Base=line, Direction=Z)
split = SplitBrep(Brep=srfgrid, Cutter=extr)
range_3 = Range(Domain=dom_2, Steps=4)
rotate = Rotate(Geometry=line, Angle=range_3, Plane=PlaneXY(0, 0, 0))  # -> Geometry, Transform
item = ListItem(List=split, Index=0, Wrap=True)
project = Project(Curve=rotate.Geometry, Brep=item, Direction=Z)

# ----
# BUILD VERTICAL PROFILES
explode = Explode(Curve=project, Recursive=True)  # -> Segments, Vertices
number_slider_2 = Slider(-0.375, range=-1..1)
join = JoinCurves(Curves=flatten(explode.Segments), Preserve=False)
explode_2 = Explode(Curve=join, Recursive=True)  # -> Segments, Vertices
eval_4 = EvaluateCurve(Curve=reparameterize(explode_2.Segments), Parameter=0.5)  # -> Point, Tangent, Angle
pdecon = Deconstruct(Point=eval_4.Point)  # -> XComponent, YComponent, ZComponent
sort = SortList(Keys=pdecon.ZComponent, ValuesA=explode_2.Segments)  # -> Keys, ValuesA
cull_i = CullIndex(List=sort.ValuesA, Indices=-1, Wrap=True)
reb = RebuildCurve(Curve=cull_i, Degree=2, Count=10, Tangents=True)  # -> simplify(Curve)
planar = Planar(Curve=reb)  # -> Planar, Plane, Deviation
offset = OffsetCurve(Curve=reb, Distance=number_slider_2, Plane=planar.Plane, Corners=1)
end = EndPoints(Curve=reb)  # -> Start, End
end_2 = EndPoints(Curve=offset)  # -> Start, End
ln = Line(StartPoint=end.Start, EndPoint=end_2.Start)  # -> flatten(Line)
ln_2 = Line(StartPoint=end.End, EndPoint=end_2.End)  # -> flatten(Line)
crv = Curve(flatten(reb))
crv_2 = Curve(flatten(offset))
merge = Merge(Data1=crv, Data2=ln, Data3=ln_2, Data4=crv_2)
join_2 = JoinCurves(Curves=merge, Preserve=False)
boundary = BoundarySurfaces(Edges=join_2)
planar_2 = Planar(Curve=boundary)  # -> Planar, Plane, Deviation
deplane = DeconstructPlane(Plane=planar_2.Plane)  # -> Origin, XAxis, YAxis, ZAxis
srf = Surface(graft(boundary))

# ----
# BUILD HORIZONTAL PROFILES
bbox = BoundingBox(Content=item, Plane=PlaneXY(0, 0, 0))  # -> Box, Box_2
series = Series(Start=0, Step=Slider(0.63, range=0..1), Count=16)
debrep = DeconstructBrep(Brep=bbox.Box)  # -> Faces, Edges, Vertices
Z_2 = UnitZ(Factor=series)
neg_2 = Negative(Value=Z_2)
item_2 = ListItem(List=debrep.Faces, Index=5, Wrap=True)
move = Move(Geometry=item_2, Motion=neg_2)  # -> Geometry, Transform
neg_3 = Negative(Value=number_slider_2)
sec = BrepPlane(Brep=item, Plane=move.Geometry)  # -> Curves, Points
planar_3 = Planar(Curve=sec.Curves)  # -> Planar, Plane, Deviation
reb_2 = RebuildCurve(Curve=sec.Curves, Count=10, Tangents=True)
offset_2 = OffsetCurve(Curve=reb_2, Distance=neg_3, Plane=planar_3.Plane, Corners=0)
ext = ExtendCurve(Curve=offset_2, Type=2, Start=0, End=0.03)
end_3 = EndPoints(Curve=reb_2)  # -> Start, End
end_4 = EndPoints(Curve=ext)  # -> Start, End
ln_3 = Line(StartPoint=end_3.Start, EndPoint=end_4.Start)  # -> flatten(Line)
ln_4 = Line(StartPoint=end_3.End, EndPoint=end_4.End)  # -> flatten(Line)
crv_3 = Curve(flatten(reb_2))
crv_4 = Curve(flatten(ext))
merge_2 = Merge(Data1=crv_3, Data2=ln_3, Data3=ln_4, Data4=crv_4)
join_3 = JoinCurves(Curves=merge_2, Preserve=False)
boundary_2 = BoundarySurfaces(Edges=join_3)

bbx = BrepBrep(BrepA=srf, BrepB=boundary_2)  # -> Curves, Points
# BUILD NOTCHES
end_5 = EndPoints(Curve=bbx.Curves)  # -> Start, End
number_slider_3 = Slider(0.125, range=0..1)
item_3 = ListItem(List=end_5.End, Index=0, Wrap=True)
scale = Scale(Geometry=bbx.Curves, Center=item_3, Factor=0.5)  # -> Geometry, Transform
eval_5 = EvaluateCurve(Curve=reparameterize(scale.Geometry), Parameter=0.5)  # -> Point, Tangent, Angle
neg_4 = Negative(Value=number_slider_3)
xy = XYPlane(Origin=eval_5.Point)
offset_3 = OffsetCurve(Curve=scale.Geometry, Distance=number_slider_3, Plane=xy, Corners=1)
offset_4 = OffsetCurve(Curve=scale.Geometry, Distance=neg_4, Plane=xy, Corners=1)
end_6 = EndPoints(Curve=offset_4)  # -> Start, End
end_7 = EndPoints(Curve=offset_3)  # -> Start, End
ln_5 = Line(StartPoint=end_7.Start, EndPoint=end_6.Start)
scale_2 = Scale(Geometry=offset_4, Center=end_6.Start, Factor=4)  # -> Geometry, Transform
scale_3 = Scale(Geometry=offset_3, Center=end_7.Start, Factor=4)  # -> Geometry, Transform
end_8 = EndPoints(Curve=scale_3.Geometry)  # -> Start, End
end_9 = EndPoints(Curve=scale_2.Geometry)  # -> Start, End
ln_6 = Line(StartPoint=end_8.End, EndPoint=end_9.End)
merge_3 = Merge(Data1=ln_5, Data2=scale_3.Geometry, Data3=scale_2.Geometry, Data4=ln_6)
boundary_3 = BoundarySurfaces(Edges=merge_3)

# ----
# BUILD NOTCHES
bbx_2 = BrepBrep(BrepA=srf, BrepB=boundary_2)  # -> Curves, Points
end_10 = EndPoints(Curve=bbx_2.Curves)  # -> Start, End
item_4 = ListItem(List=end_10.Start, Index=0, Wrap=True)
scale_4 = Scale(Geometry=bbx_2.Curves, Center=item_4, Factor=0.5)  # -> Geometry, Transform
Z_3 = UnitZ(Factor=Slider(0.125, range=0..1))
neg_5 = Negative(Value=Z_3)
move_2 = Move(Geometry=scale_4.Geometry, Motion=Z_3)  # -> Geometry, Transform
move_3 = Move(Geometry=scale_4.Geometry, Motion=neg_5)  # -> Geometry, Transform
end_11 = EndPoints(Curve=move_3.Geometry)  # -> Start, End
end_12 = EndPoints(Curve=move_2.Geometry)  # -> Start, End
scale_5 = Scale(Geometry=move_3.Geometry, Center=end_11.End, Factor=4)  # -> Geometry, Transform
ln_7 = Line(StartPoint=end_12.End, EndPoint=end_11.End)
end_13 = EndPoints(Curve=scale_5.Geometry)  # -> Start, End
ln_8 = Line(StartPoint=end_12.Start, EndPoint=end_13.Start)
merge_4 = Merge(Data1=move_2.Geometry, Data2=ln_7, Data3=scale_5.Geometry, Data4=ln_8)
boundary_4 = BoundarySurfaces(Edges=merge_4)

# ----
# BOOLEAN HORIZONTAL MEMBERS
neg_6 = Negative(Value=number_slider_3)
multiplication_2 = Multiplication(A=number_slider_3, B=2)
neg_7 = Negative(Value=number_slider_3)
multiplication_3 = Multiplication(A=number_slider_3, B=2)
Z_4 = UnitZ(Factor=neg_6)
Z_5 = UnitZ(Factor=multiplication_2)
Z_6 = UnitZ(Factor=neg_7)
Z_7 = UnitZ(Factor=multiplication_3)
extr_2 = Extrude(Base=boundary_2, Direction=Z_5)
extr_3 = Extrude(Base=boundary_3, Direction=Z_7)
move_4 = Move(Geometry=extr_3, Motion=Z_4)  # -> Geometry, Transform
move_5 = Move(Geometry=extr_2, Motion=Z_6)  # -> Geometry, Transform
sdiff = SolidDifference(BrepsA=graft(move_5.Geometry), BrepsB=flatten(move_4.Geometry))  # -> flatten(Result)
debrep_2 = DeconstructBrep(Brep=sdiff)  # -> Faces, Edges, Vertices
preview_2 = CustomPreview(Geometry=debrep_2.Faces, Material=ColourSwatch(SwatchColor=RGB(214, 69, 255)))

planar_4 = Planar(Curve=boundary_4)  # -> Planar, Plane, Deviation
deplane_2 = DeconstructPlane(Plane=planar_4.Plane)  # -> Origin, XAxis, YAxis, ZAxis
# BOOLEAN VERTICAL MEMBERS
multiplication_4 = Multiplication(A=number_slider_3, B=2)
neg_8 = Negative(Value=number_slider_3)
amp = Amplitude(Vector=deplane_2.ZAxis, Amplitude=multiplication_4)
multiplication_5 = Multiplication(A=number_slider_3, B=2)
neg_9 = Negative(Value=number_slider_3)
Z_8 = UnitZ(Factor=multiplication_5)
amp_2 = Amplitude(Vector=deplane_2.ZAxis, Amplitude=neg_8)
amp_3 = Amplitude(Vector=deplane.ZAxis, Amplitude=multiplication_5)
extr_4 = Extrude(Base=boundary, Direction=amp_3)
extr_5 = Extrude(Base=boundary_4, Direction=amp)
move_6 = Move(Geometry=extr_5, Motion=amp_2)  # -> Geometry, Transform

amp_4 = Amplitude(Vector=deplane.ZAxis, Amplitude=neg_9)

move_7 = Move(Geometry=extr_4, Motion=amp_4)  # -> Geometry, Transform
sdiff_2 = SolidDifference(BrepsA=graft(move_7.Geometry), BrepsB=flatten(move_6.Geometry))
preview_3 = CustomPreview(Geometry=sdiff_2, Material=ColourSwatch(SwatchColor=RGB(0, 179, 255)))
